% Simulink data dictionary MCU_FOC_MAIN_DD.sldd

WALKMODE_SPD_LIM_U16 = Simulink.Parameter(4500, StorageClass="ExportedGlobal", DataType="uint16", Unit="meter/hour")
THROTTLE_THRESHOLD_U16 = Simulink.Parameter(950, StorageClass="ExportedGlobal", DataType="uint16", Unit="meter/hour")
THROTTLE_SPD_LIM_U16 = Simulink.Parameter(25000, StorageClass="ExportedGlobal", DataType="uint16", Unit="meter/hour")
DEFAULT_SPD_LIM_U16 = Simulink.Parameter(0, StorageClass="ExportedGlobal", DataType="uint16", Unit="meter/hour")
PAS_ONE_SPD_THSD_U16 = Simulink.Parameter(13200, StorageClass="ExportedGlobal", DataType="uint16", Unit="meter/hour")
PAS_TWO_SPD_THSD_U16 = Simulink.Parameter(16200, StorageClass="ExportedGlobal", DataType="uint16", Unit="meter/hour")
PAS_THREE_SPD_THSD_U16 = Simulink.Parameter(19200, StorageClass="ExportedGlobal", DataType="uint16", Unit="meter/hour")
PAS_FOUR_SPD_THSD_U16 = Simulink.Parameter(22200, StorageClass="ExportedGlobal", DataType="uint16", Unit="meter/hour")
PAS_FIVE_SPD_THSD_U16 = Simulink.Parameter(25000, StorageClass="ExportedGlobal", DataType="uint16", Unit="meter/hour")
DEFAULT_PAS_SPD_U16 = Simulink.Parameter(0, StorageClass="ExportedGlobal", DataType="uint16", Unit="meter/hour")
FITNESS_MODE_U8 = Simulink.Parameter(5, StorageClass="ExportedGlobal", DataType="uint8")